# Grasshopper definition urdf_loader.gh (Grasshopper 1.0.8)
# plug-ins: RhinoCodePluginGH

panel = Panel("/Users/avery_tsai/OrbStack/docker/volumes/walker_arm/src/walker_arm/hiwin_description")
merge = Merge(
    Data1=Slider(7, range=-170..170),
    Data2=Slider(-47, range=-150..95),
    Data3=Slider(27, range=-85..185),
    Data4=Slider(-47, range=-190..190),
    Data5=Slider(-16, range=-135..135),
    Data6=Slider(43, range=-360..360))
panel_2 = Panel("/Users/avery_tsai/OrbStack/docker/volumes/walker_arm/src/walker_arm/hiwin_description/urdf/rebar_arm.urdf")
merge_2 = Merge(
    Data1=Slider(-88, range=-185..85),
    Data2=Slider(-79, range=-155..35),
    Data3=Slider(117, range=-130..154),
    Data4=Slider(87, range=-350..350),
    Data5=Slider(3, range=-130..130),
    Data6=Slider(61, range=-350..350))
py3 = Python3Script(DirPath=panel, Reload=Button())  # -> out, Meshes, Paths; inputs DirPath: String, Reload: Boolean
# ---------- py3: Python ----------
# ========== 電池01：載入網格 ==========
# 輸入：DirPath (str), Reload (bool)
# 輸出：Meshes, Paths

import sys
sys.path.append(r"/Users/avery_tsai/project/hiwin_prc")
from robot import mesh_loader

# 載入網格（自動遞迴搜尋 .stl 檔案）
Meshes, Paths = mesh_loader.load(
    DirPath if 'DirPath' in globals() and DirPath else r"/Users/avery_tsai/project/hiwin_prc/urdf/walker_arm",
    Reload if 'Reload' in globals() else False
)

a = Meshes
# ---------- end py3 ----------
panel_3 = Panel("/Users/avery_tsai/project/robosim/urdf/kuka_kr300_support/urdf/kr300r2500ultra.urdf")
toggle = BooleanToggle(True)
button = Button()
py3_2 = Python3Script(DirPath="/Users/avery_tsai/project/robosim/urdf/kuka_kr300_support", Reload=Button())  # -> out, Meshes, Paths; inputs DirPath: String, Reload: Boolean; same code as py3
py3_3 = Python3Script(URDFPath=panel_2, Meshes=py3.Meshes, MeshPaths=py3.Paths, J=merge, Deg=toggle, Reload=button)  # -> out, G, a, Names, JointOrder; inputs URDFPath: String, Meshes: list of Mesh, MeshPaths: list of String, J: list of Double, Deg: Boolean, Reload: Boolean
# ---------- py3_3: Python ----------
# ========== 電池02：URDF 運動學 ==========
# 輸入：URDFPath (str), Meshes (list), MeshPaths (list), J (list), Deg (bool), Reload (bool)
# 輸出：G, Names, JointOrder

import sys
sys.path.append(r"/Users/avery_tsai/project/hiwin_prc")
from robot import urdf_loader

# 載入 URDF 並計算運動學
G, Names, JointOrder = urdf_loader.load(
    URDFPath if 'URDFPath' in globals() and URDFPath else r"/Users/avery_tsai/project/hiwin_prc/urdf/walker_arm/urdf/walker_arm.urdf",
    Meshes if 'Meshes' in globals() else [],
    MeshPaths if 'MeshPaths' in globals() else [],
    J if 'J' in globals() and J else [0, 0, 0, 0, 0, 0],
    Deg if 'Deg' in globals() else True,
    Reload if 'Reload' in globals() else False
)

a = G
# ---------- end py3_3 ----------
py3_4 = Python3Script(URDFPath=panel_3, Meshes=py3_2.Meshes, MeshPaths=py3_2.Paths, J=merge_2, Deg=Toggle(True), Reload=Button())  # -> out, G, a, Names, JointOrder; inputs URDFPath: String, Meshes: list of Mesh, MeshPaths: list of String, J: list of Double, Deg: Boolean, Reload: Boolean; same code as py3_3
ipy2 = IronPython2Script(URDFPath=panel_2, Meshes=py3.Meshes, MeshPaths=py3.Paths, J=merge, Deg=toggle, Reload=button)  # -> out, G, a; inputs URDFPath: String, Meshes: list of Mesh, MeshPaths: list of String, J: list, Deg: Boolean, Reload: Boolean
# ---------- ipy2: IronPython ----------
import sys
sys.path.append(r"/Users/avery_tsai/project/hiwin_prc")
from robot import urdf_loader

# 載入 URDF 並計算運動學
G, Names, JointOrder = urdf_loader.load(
    URDFPath if 'URDFPath' in globals() and URDFPath else r"/Users/avery_tsai/project/hiwin_prc/urdf/walker_arm/urdf/walker_arm.urdf",
    Meshes if 'Meshes' in globals() else [],
    MeshPaths if 'MeshPaths' in globals() else [],
    J if 'J' in globals() and J else [0, 0, 0, 0, 0, 0],
    Deg if 'Deg' in globals() else True,
    Reload if 'Reload' in globals() else False
)

a = G
# ---------- end ipy2 ----------
scale = Scale(Center=Point(0, 0, 0), Factor=Slider(1000, range=0..1000))  # -> Geometry, Transform
scale_2 = Scale(Geometry=py3_3.G, Center=Point(0, 0, 0), Factor=Slider(1000, range=0..1000))  # -> Geometry, Transform
panel_4 = Panel(py3_4.G)
panel_5 = Panel(py3_3.JointOrder)
